# Dynamo graph Miscellany-Samples-GeometryDisplay.dyn (Dynamo 2.0.1.5055)

code_block = CodeBlock { [1000,0,4000,5000,6000]; [1000,2000,1000,0,1000]; [6000,3000,5000,3000,5000]; }
byCoordinates = Point.ByCoordinates(x=code_block.out0, y=code_block.out1, z=code_block.out2)
byPoints = NurbsCurve.ByPoints(points=byCoordinates)
number_of_points = IntegerSlider(25, range=1..100 step 1)
code_block_2 = CodeBlock(n=number_of_points) { 0..1..#n; }
normalAtParameter = Curve.NormalAtParameter(curve=byPoints, param=code_block_2)
pointAtParameter = Curve.PointAtParameter(curve=byPoints, param=code_block_2)
display_scale = IntegerSlider(829, range=0..1000 step 1)
planeAtParameter = Curve.PlaneAtParameter(curve=byPoints, param=code_block_2)

# group: Miscellany
display = Miscellany.Geometry.Abstract.Vector.Display(vector=normalAtParameter, startPoint=pointAtParameter, scale=display_scale)
display_2 = Miscellany.Geometry.Abstract.Plane.Display(plane=planeAtParameter, length=display_scale)
